# Grasshopper definition tetris.gh (Grasshopper 1.0.7)

I = Geometry([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])
invz = Geometry([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])
Z = Geometry([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])
T = Geometry([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])
invl = Geometry([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])
L = Geometry([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])
group = Group(Objects=L)
group_2 = Group(Objects=invl)
group_3 = Group(Objects=T)
group_4 = Group(Objects=Z)
group_5 = Group(Objects=invz)
group_6 = Group(Objects=I)
active = BooleanToggle(False)
reset = Button()
trigger = Trigger(Interval=300, TimerInterval=300, Target=[Y, c_script, c_script_2])  # disabled
merge = Merge(Data1=group, Data2=group_2, Data3=group_3, Data4=group_4, Data5=group_5, Data6=group_6)
c_script = CSharpScript(reset=reset, active=active)  # -> id, nextId; inputs reset: Boolean, active: Boolean
# ---------- c_script: C# usings ----------
using Rhino.DocObjects;
# ---------- c_script: C# ----------
    RhinoDoc.AddRhinoObject -= AddRhinoObjectEventHandler;
    if(active) RhinoDoc.AddRhinoObject += AddRhinoObjectEventHandler;

    if(reset)
    {
      Random rnd = new Random();
      _nextId = rnd.Next(0, 6);
      _id = rnd.Next(0, 6);
    }

    id = _id;
    nextId = _nextId;
# ---------- c_script: C# additional code ----------
  int _id;
  int _nextId;

  void AddRhinoObjectEventHandler(object sender, RhinoObjectEventArgs e)
  {
    if(e.TheObject.Attributes.GetUserString("EventTrigger") == "None")
    {
      Random rnd = new Random();
      _id = _nextId;
      _nextId = rnd.Next(0, 6);
    }
  }
# ---------- end c_script ----------
c_script_2 = CSharpScript(reset=reset, active=active)  # -> out, score; inputs reset: Boolean, active: Boolean
# ---------- c_script_2: C# usings ----------
using Rhino.DocObjects;
using System.Linq;
# ---------- c_script_2: C# ----------
    RhinoDoc.AddRhinoObject -= AddRhinoObjectEventHandler;
    if(active)
    {
      RhinoDoc.AddRhinoObject += AddRhinoObjectEventHandler;
    }
    if(reset)
    {
      _score = 0;
      IEnumerable<RhinoObject> blocks = RhinoDocument.Objects.FindByUserString("ColorBlock", "None", true);
      foreach(RhinoObject block in blocks)
      {
        RhinoDocument.Objects.Delete(block, true);
      }
    }

    score = String.Format("score: {0}", _score);
# ---------- c_script_2: C# additional code ----------
  float gridSize = 5;
  int _score = 0;

  void AddRhinoObjectEventHandler(object sender, RhinoObjectEventArgs e)
  {

    if(e.TheObject.Attributes.GetUserString("hoge") == "hoge") return;
    //Get posy in bakedobj
    Brep brep = e.TheObject.Geometry as Brep;
    float posy = (float) AreaMassProperties.Compute(brep).Centroid.Y;

    //Get ColorBlocks
    IEnumerable<RhinoObject> blocks = RhinoDocument.Objects.FindByUserString("ColorBlock", "None", true);
    IEnumerable<RhinoObject> rowBlocks = blocks.Where(ro => (float) AreaMassProperties.Compute(ro.Geometry as Brep).Centroid.Y == posy);
    if(rowBlocks.Count() == 10)
    {
      foreach(RhinoObject block in rowBlocks)
      {
        RhinoDocument.Objects.Delete(block, true);
      }

      IEnumerable<RhinoObject> aboveBlocks = blocks.Where(ro => (float) AreaMassProperties.Compute(ro.Geometry as Brep).Centroid.Y > posy);

      ObjectAttributes attrib = RhinoDocument.CreateDefaultAttributes();
      attrib.SetUserString("Block", "Block");
      attrib.SetUserString("ColorBlock", "None");
      attrib.ColorSource = ObjectColorSource.ColorFromObject;

      foreach(RhinoObject block in aboveBlocks)
      {
        Brep geo = block.Geometry as Brep;
        geo.Translate(0, -gridSize, 0);
        block.Attributes.SetUserString("hoge", "hoge");
        block.Attributes.DeleteUserString("EventTrigger");

        RhinoDocument.Objects.Add(geo, block.Attributes);
        RhinoDocument.Objects.Delete(block, true);

      }
      _score += 1000;
    }


  }
# ---------- end c_script_2 ----------
Y = CSharpScript(reset=reset, active=active)  # -> yVec; inputs reset: Boolean, active: Boolean
# ---------- Y: C# ----------
    RhinoDoc.AddRhinoObject -= AddRhinoObjectEventHandler;
    RhinoDoc.SelectObjects -= SelectObjectEventHandler;
    if(active)
    {
      RhinoDoc.AddRhinoObject += AddRhinoObjectEventHandler;
      RhinoDoc.SelectObjects += SelectObjectEventHandler;
    }
    if(_active && active)
    {
      i++;
      yVec = new Vector3f(0, -Math.Min(i, 25) * gridSize, 0);
    }

    if(!reset && _reset)
    {
      i = 0;
    }
    _reset = reset;
    _active = active;
# ---------- Y: C# additional code ----------
  int i = 0;
  bool _reset;
  bool _active;
  int gridSize = 5;

  void AddRhinoObjectEventHandler(object sender, RhinoObjectEventArgs e)
  {
    i = 0;
  }

  void SelectObjectEventHandler(object  sender, RhinoObjectSelectionEventArgs e)
  {
    RhinoDocument.Objects.UnselectAll();
    RhinoObject selObj = e.RhinoObjects[0];
    if(selObj.Attributes.GetUserString("Button") == "Down")
    {
      this.Component.ExpireSolution(true);
    }
  }
# ---------- end Y ----------
merge_2 = Merge(
    Data1=ColourSwatch(SwatchColor=RGB(184, 132, 0)),
    Data2=ColourSwatch(SwatchColor=RGB(25, 0, 189)),
    Data3=ColourSwatch(SwatchColor=RGB(129, 0, 184)),
    Data4=ColourSwatch(SwatchColor=RGB(181, 0, 12)),
    Data5=ColourSwatch(SwatchColor=RGB(93, 207, 0)),
    Data6=ColourSwatch(SwatchColor=RGB(0, 191, 191)))
c_script_3 = CSharpScript(active=active)  # inputs active: Boolean
# ---------- c_script_3: C# usings ----------
using System.Linq;
using Grasshopper.Kernel.Special;
# ---------- c_script_3: C# ----------
    var enm = GrasshopperDocument.Objects.Where(i => i.GetType().ToString() == "Grasshopper.Kernel.Special.GH_Timer");
    GH_Timer timer = enm.ElementAt(0) as GH_Timer;
    if(active)
    {
      
      timer.Locked = false;
    }else
    {
      timer.Locked = true;
    }
# ---------- end c_script_3 ----------
pt = Point(Point(35, -30, 0))
item = ListItem(List=merge, Index=c_script.id, Wrap=True)
ungroup = Ungroup(Group=item)
c_script_4 = CSharpScript(brep=ungroup)  # -> pts; inputs brep: Brep
# ---------- c_script_4: C# usings ----------
using System.Linq;
# ---------- c_script_4: C# ----------
    pts = AreaMassProperties.Compute(brep).Centroid;
# ---------- end c_script_4 ----------
c_script_5 = CSharpScript(reset=reset, active=active, yVec=Y, centerPts=c_script_4)  # -> xVec, outPt; inputs reset: Boolean, active: Boolean, yVec: Vector3d, centerPts: list of Point3d
# ---------- c_script_5: C# ----------
    initCenterPts = centerPts.Select(k => (Point3f) k);

    RhinoDoc.SelectObjects -= SelectObjectEventHandler;
    RhinoDoc.AddRhinoObject -= AddRhinoObjectEventHandler;
    if(active)
    {
      //Add Events
      RhinoDoc.SelectObjects += SelectObjectEventHandler;
      RhinoDoc.AddRhinoObject += AddRhinoObjectEventHandler;
      //Fetch blockPts
      blockPts = RhinoDocument.Objects.FindByUserString("Block", "Block", true).Select(ro => (Point3f) AreaMassProperties.Compute(ro.Geometry as Brep).Centroid);
      //Get yVector
      _yvec = (Vector3f) yVec;

      //Get each center pts
      //
      _centerPts = initCenterPts;
      //Move
      _centerPts = _centerPts.Select(pt => pt + _yvec + _xvec);

      //Create centerPt for rotation
      centerPt = new Point3f(gridSize / 2, gridSize / 2, 0);
      //Move
      centerPt += _yvec;
      centerPt += _xvec;

      //Rotate
      Transform xform = Transform.Rotation(angle, centerPt);
      List<Point3f> __centerPts = new List<Point3f>();
      foreach(Point3f pt in _centerPts)
      {
        pt.Transform(xform);
        __centerPts.Add(pt);
      }
      _centerPts = __centerPts;

      //init bakeFrag
      bakeFrag = false;
    }

    if(reset)
    {
      Reset();
    }



    xVec = _xvec;

    if(_centerPts != null)
    {
      outPt = _centerPts;
    }else
    {
      outPt = centerPts;
    }
# ---------- c_script_5: C# additional code ----------
  //Vector3f initVec;
  Vector3f _xvec;
  Vector3f _yvec;
  float gridSize = 5;
  bool bakeFrag;
  IEnumerable<Point3f> blockPts;
  IEnumerable<Point3f> initCenterPts;
  IEnumerable<Point3f> _centerPts;
  Point3f centerPt;
  double angle ;

  void Reset()
  {
    _xvec = new Vector3f(0, 0, 0);
    _yvec = new Vector3f(0, 0, 0);
    _centerPts = initCenterPts;
    angle = 0;
  }

  void SelectObjectEventHandler(object  sender, RhinoObjectSelectionEventArgs e)
  {
    //RhinoDocument.Objects.UnselectAll();
    if(e.RhinoObjects.Count() > 1) return;
    if(bakeFrag) return;

    RhinoObject selObj = e.RhinoObjects[0];

    if(selObj.Attributes.GetUserString("Button") == "Right")
    {
      Vector3f moveVec = new Vector3f(gridSize, 0, 0);
      if(_centerPts.Any(cpt => blockPts.Contains(cpt + moveVec))) return;
      _xvec += moveVec;

      this.Component.ExpireSolution(true);
    }

    if(selObj.Attributes.GetUserString("Button") == "Left")
    {
      Vector3f moveVec = new Vector3f(-gridSize, 0, 0);
      if(_centerPts.Any(cpt => blockPts.Contains(cpt + moveVec))) return;
      _xvec += moveVec;

      this.Component.ExpireSolution(true);
    }

    if(selObj.Attributes.GetUserString("Button") == "Rotate")
    {
      Transform xform = Transform.Rotation(Math.PI / 2, centerPt);
      IEnumerable<Point3f> __centerPts = _centerPts;
      foreach(Point3f pt in __centerPts)
      {
        pt.Transform(xform);
        if(blockPts.Contains(pt)) return;
      }
      angle += Math.PI / 2;

      this.Component.ExpireSolution(true);
    }


  }

  void AddRhinoObjectEventHandler(object sender, RhinoObjectEventArgs e)
  {
    if(e.TheObject.Attributes.GetUserString("EventTrigger") == "None")
    {
      Reset();
      bakeFrag = true;
    }
  }
# ---------- end c_script_5 ----------
tag = TextTag3D(Location=pt, Text=c_script_2.score, Size=3, Justification=7)
subtraction = Subtraction(A=c_script_5.outPt, B=c_script_4)
item_2 = ListItem(List=merge_2, Index=c_script.id, Wrap=True)
vec = VectorXYZ(XComponent="42", YComponent="-10", ZComponent=0)  # -> Vector, Length
item_3 = ListItem(List=merge, Index=c_script.nextId, Wrap=True)
pdecon = Deconstruct(Point=c_script_5.outPt)  # -> XComponent, YComponent, ZComponent
move = Move(Geometry=ungroup, Motion=subtraction)  # -> Geometry, Transform
move_2 = Move(Geometry=item_3, Motion=vec.Vector)  # -> Geometry, Transform
item_4 = ListItem(List=merge_2, Index=c_script.nextId, Wrap=True)
sort = SortList(Keys=pdecon.YComponent, ValuesA=move.Geometry)  # -> Keys, reverse(ValuesA)
preview = CustomPreview(Geometry=move_2.Geometry, Material=item_4)
c_script_6 = CSharpScript(breps=sort.ValuesA, col=item_2)  # -> A; inputs breps: list of Brep, col: Color
# ---------- c_script_6: C# usings ----------
using System.Linq;
using Rhino.DocObjects;
# ---------- c_script_6: C# ----------
    if(CanBake(breps))
    {
      ObjectAttributes attrib = RhinoDocument.CreateDefaultAttributes();
      attrib.SetUserString("Block", "Block");
      attrib.SetUserString("ColorBlock", "None");
      attrib.ColorSource = ObjectColorSource.ColorFromObject;
      attrib.ObjectColor = col;
      int listLen = _breps.Count();
      for(int i = 0; i < listLen; i++)
      {
        if(i == listLen - 1) attrib.SetUserString("EventTrigger", "None");
        RhinoDocument.Objects.Add(_breps[i], attrib);
      }
      A = null;

    }else
    {

      A = breps;
    }

    //save

    _breps = breps;
# ---------- c_script_6: C# additional code ----------
  List<Brep> _breps;

  bool CanBake(List<Brep> breps)
  {
    RhinoObject[] blocks = RhinoDocument.Objects.FindByUserString("Block", "Block", true);
    var blockPts = blocks.Select(ro => (Point3f) AreaMassProperties.Compute(ro.Geometry as Brep).Centroid);
    IEnumerable<Point3f> currentBlockPts = breps.Select(br => (Point3f) AreaMassProperties.Compute(br).Centroid);
    return currentBlockPts.Any(pt => blockPts.Contains(pt));
  }
# ---------- end c_script_6 ----------
preview_2 = CustomPreview(Geometry=c_script_6, Material=item_2)
